# Grasshopper definition Perforated_Brick_Wall_GH.gh (Grasshopper 1.0.8)
# plug-ins: PTComponentLibrary
# 自由にお使いいただけますが、問題が起きても一切の責任を負いません。
# このファイルは私の著作物です、ライセンスはMITに従います。

# ----
# 段数
# 2段1セット数
number_slider = Slider(5, range=0..10)
multiplication = Multiplication(A="2", B=number_slider)
addition = Addition(A="2", B=multiplication)
panel = Panel(addition)

# ----
# original curve
# 直線時のブロックの重なり
crv = Curve(<curve referenced from the Rhino model>)

# ----
# BOXSIZE
# WIDE
# DEPTH
# HEIGHT
number_slider_2 = Slider(60, range=0..1000)
number_slider_3 = Slider(241, range=0..1000)

panel_2 = Panel(number_slider_3)
subtraction = Subtraction(A=panel_2, B=Slider(96, range=0..100))

# ----
# ブロックを固定する位置の距離
panel_3 = Panel(subtraction)

ptdividedis = DivideDistance(Curve=crv, Distance=subtraction, AddEnd=True)
rectangle = Rectangle(Plane=PlaneXY(0, 0, 0), XSize=number_slider_3, YSize=Slider(55, range=0..1000), Radius=0)  # -> Rectangle, Length
boxrec = BoxRectangle(Rectangle=rectangle.Rectangle, Height=number_slider_2)
division = Division(A=number_slider_2, B="2")
len = Length(Curve=crv)
panel_4 = Panel(ptdividedis)
box = Box(boxrec)

# ----
# curve length
panel_5 = Panel(len)

volume = Volume(Geometry=box)  # -> Volume, Centroid
shift = ShiftList(List=ptdividedis, Shift="1", Wrap=invert(True))
pt = Point(volume.Centroid)
Z = UnitZ(Factor=division)
ln = Line(StartPoint=ptdividedis, EndPoint=shift)
neg = Negative(Value=Z)
# Feel free to use this file at your own risk. The author is not responsible for any issues or damages.
# This work is licensed under the MIT License.
# 
# (C) 2026 YUKI MATSUDA / Architectural Solutions Design Office
panel_6 = Panel(shift)
midpt = CurveMiddle(Curve=ln)
move = Move(Geometry=pt, Motion=neg)  # -> Geometry, Transform
cull = CullPattern(List=ln, CullPattern=invert([True, False]))
cull_2 = CullPattern(List=ln, CullPattern=[True, False])
cull_3 = CullPattern(List=midpt, CullPattern=invert([True, False]))
cull_4 = CullPattern(List=midpt, CullPattern=[True, False])
pl = ConstructPlane(Origin=move.Geometry, XAxis=Vector(1, 0, 0), YAxis=Vector(0, 1, 0))
# 自由にお使いいただけますが、問題が起きても一切の責任を負いません。
# 
# このファイルは私の著作物です、ライセンスはMITに従います。
pl_2 = ConstructPlane(Origin=cull_3, XAxis=cull, YAxis=Vector(0, 1, 0))
pl_3 = ConstructPlane(Origin=cull_4, XAxis=cull_2, YAxis=Vector(0, 1, 0))
Z_2 = UnitZ(Factor=number_slider_2)
orient = Orient(Geometry=box, Source=pl, Target=pl_2)  # -> Geometry, Transform
# １段目のブロック
orient_2 = Orient(Geometry=box, Source=pl, Target=pl_3)  # -> Geometry, Transform
# 2段目のブロック
move_2 = Move(Geometry=orient.Geometry, Motion=Z_2)  # -> Geometry, Transform
multiplication_2 = Multiplication(A=number_slider_2, B="2")
merge = Merge(Data1=orient_2.Geometry, Data2=move_2.Geometry)
series = Series(Start=multiplication_2, Step=multiplication_2, Count=number_slider)
Z_3 = UnitZ(Factor=series)
move_3 = Move(Geometry=merge, Motion=graft(Z_3))  # -> Geometry, Transform
geo = Geometry([move_3.Geometry, merge])
